# Grasshopper definition g-code-slicer.gh (Grasshopper 1.0.7)
# plug-ins: Bifocals

geometry_pipeline = GeometryPipeline(
    GroupByLayer=False,
    GroupByType=False,
    IncludeHidden=True,
    IncludeLocked=True,
    LayerFilter="*03",
    NameFilter="*",
    SublayerFiltering=True,
    TypeFilter=4)
sort_list = SortList(Keys=geometry_pipeline, ValuesValuesA=geometry_pipeline)  # -> Keys, ValuesValuesA
rebuild_curve = RebuildCurve(Curve=geometry_pipeline, Count=50, Tangents=False)
point_on_curve = PointOnCurve(rebuild_curve, parameter=1)

list_item = ListItem(List=sort_list.ValuesValuesA, Index=0, Wrap=True)
flip_curve = FlipCurve(Curve=sort_list.ValuesValuesA, Guide=list_item)  # -> Curve, Flag

deconstruct = Deconstruct(Point=point_on_curve)  # -> XComponent, YComponent, ZComponent

point = Point(<point referenced from the Rhino model>)
curve_closest_point = CurveClosestPoint(Point=point, Curve=flip_curve.Curve)  # -> Point, Parameter, Distance
seam = Seam(Curve=flip_curve.Curve, Seam=curve_closest_point.Parameter)

loft = Loft(Curves=seam, Options={Adjust=False, Closed=False, LoftEnds=0, LoftSimp=1, LoftType=3, Rebuild=10, Refit=0.01})

number_slider = Slider(104, range=0..1000)
unit_y = UnitY(Factor=number_slider)
unit_x = UnitX(Factor=number_slider)
geometry = Geometry(loft)
move = Move(Geometry=geometry, Motion=unit_y)  # -> Geometry, Transform
move_2 = Move(Geometry=move.Geometry, Motion=unit_x)  # -> Geometry, Transform

series = Series(Start=0, Step=1, Count=Slider(0, range=0..20))
geometry_2 = Geometry(move_2.Geometry)

unit_z = UnitZ(Factor=1)
contour = Contour(Shape=geometry_2, Point=Point(0, 0, 0), Direction=unit_z, Distance=Slider(0.247, range=0..1))
panel = Panel(contour)

e_wert = Slider(10, range=0..50)
X = Panel(" X")
multiplication = Multiplication(A=Slider(12, range=0..100), B=Slider(48, range=0..100))
move_3 = Panel("G1")
speed = Panel(" F")
Y = Panel(" Y")
Z = Panel(" Z")
extrude_rate = Panel(" E")
end = Panel("""; — END OF GCODE —

M140 S0
M204 S3000
M205 X20 Y20
M107
G91 ;Relative movement
G90 ;Disable relative movement
M82 ;absolute extrusion mode
M104 S0
M104 T1 S0
;— end of END OF GCODE -""")
start = Panel(""";START_OF_HEADER
;HEADER_VERSION:0.1
;FLAVOR:Griffin
;GENERATOR.NAME:Cura_SteamEngine
;GENERATOR.VERSION:4.7.1
;GENERATOR.BUILD_DATE:2020-09-02
;TARGET_MACHINE.NAME:Ultimaker 3
;EXTRUDER_TRAIN.0.INITIAL_TEMPERATURE:205
;EXTRUDER_TRAIN.0.MATERIAL.VOLUME_USED:81
;EXTRUDER_TRAIN.0.MATERIAL.GUID:506c9f0d-e3aa-4bd4-b2d2-23e2425b1aa9
;EXTRUDER_TRAIN.0.NOZZLE.DIAMETER:0.4
;EXTRUDER_TRAIN.0.NOZZLE.NAME:AA 0.4
;BUILD_PLATE.TYPE:glass
;BUILD_PLATE.INITIAL_TEMPERATURE:60
;PRINT.TIME:95
;PRINT.GROUPS:1
;PRINT.SIZE.MIN.X:9
;PRINT.SIZE.MIN.Y:6
;PRINT.SIZE.MIN.Z:0.27
;PRINT.SIZE.MAX.X:125.628
;PRINT.SIZE.MAX.Y:116.295
;PRINT.SIZE.MAX.Z:3.87
;END_OF_HEADER
;Generated with Cura_SteamEngine 4.7.1
T0
M82 ;absolute extrusion mode

G92 E0
M109 S195
G0 F15000 X9 Y6 Z2
G280
G1 F1500 E-6.5
;LAYER_COUNT:39
;LAYER:0
M107
M204 S625
M205 X6 Y6
G1 F600 Z2.27
G0 F4285.7 X109.682 Y101.958 Z2.27
M204 S500
M205 X5 Y5

;END_OF_HEADER""")

layer_height = Slider(0.6, range=0..1)
unit_z_2 = UnitZ(Factor=1)
contour_2 = Contour(Shape=geometry_2, Point=Point(0, 0, 0), Direction=unit_z_2, Distance=layer_height)
brep = Brep(geometry_2)
panel_2 = Panel("""1
1
0
0""")
N = Slider(80, range=0..100)
panel_3 = Panel("""1
0""")
integer = Integer(panel_3)
integer_2 = Integer(panel_2)
expression = Expression(x=integer_2, Expression="if(x=0, 1, 0)")
expression_2 = Expression(x=integer, Expression="if(x=0, 1, 0)")
panel_4 = Panel(expression_2)
panel_5 = Panel(expression)

cull_index = CullIndex(List=flatten(contour_2), Indices=series, Wrap=True)
curve = Curve(cull_index)
list_item_2 = ListItem(List=flatten(contour_2), Index=series, Wrap=True)

dispatch = Dispatch(List=flatten(curve), DispatchPattern=panel_2)  # -> ListA, ListB
curve_2 = Curve(dispatch.ListB)
divide_curve = DivideCurve(Curve=curve_2, Count=N, Kinks=False)  # -> Points, Tangents, Parameters
dispatch_2 = Dispatch(List=divide_curve.Points, DispatchPattern=panel_3)  # -> ListA, ListB
point_2 = Point(dispatch_2.ListB)
brep_closest_point = BrepClosestPoint(Point=point_2, Brep=brep)  # -> Point, Normal, Distance

# ---- group: curve attractor
curve_3 = Curve(<curve referenced from the Rhino model>)
curve_closest_point_2 = CurveClosestPoint(Point=point_2, Curve=curve_3)  # -> Point, Parameter, Distance

# ---- group: point attractor
populate_geometry = PopulateGeometry(Geometry=geometry_2, Count=Slider(3, range=0..10), Seed=Slider(5, range=0..10))
construct_domain = ConstructDomain(DomainStart=Slider(3, range=0..10), DomainEnd=Slider(0, range=0..100))
closest_point = ClosestPoint(Point=populate_geometry)  # -> ClosestPoint, CPIndex, Distance
minimum = Minimum(A=curve_closest_point_2.Distance, B=Slider(23, range=0..100))
bounds = Bounds(Numbers=minimum)
remap_numbers = RemapNumbers(Value=minimum, Source=bounds, Target=construct_domain)  # -> Mapped, Clipped

# ----
amplitude = Amplitude(Vector=brep_closest_point.Normal, Amplitude=remap_numbers.Mapped)
reverse = Reverse(Vector=amplitude)
move_4 = Move(Geometry=point_2, Motion=reverse)  # -> Geometry, Transform
weave = Weave(Pattern=panel_4, Stream0=dispatch_2.ListA, Stream1=move_4.Geometry, NullGaps=False)
polyline = PolyLine(Vertices=weave, Closed=Toggle(True))
weave_2 = Weave(Pattern=panel_5, Stream0=dispatch.ListA, Stream1=flatten(polyline), NullGaps=False)

insert_items = InsertItems(List=flatten(weave_2), Item=list_item_2, Indices=Slider(0, range=0..100), Wrap=True)
panel_6 = Panel(weave_2)

list_length = ListLength(List=flatten(insert_items))
mass_addition = MassAddition(Input=list_length)  # -> Result, PartialResults
subtraction = Subtraction(A=mass_addition.Result, B=Slider(1, range=0..1))
cull_index_2 = CullIndex(List=flatten(insert_items), Indices=subtraction, Wrap=True)
curve_4 = Curve(cull_index_2)

number_slider_2 = Slider(100, range=0..100)
divide_curve_2 = DivideCurve(Curve=curve_4, Count=number_slider_2, Kinks=False)  # -> Points, Tangents, Parameters
flip_matrix = FlipMatrix(Data=divide_curve_2.Points)
polyline_2 = PolyLine(Vertices=flip_matrix, Closed=False)
explode = Explode(Curve=polyline_2, Recursive=True)  # -> Segments, Vertices
end_points = EndPoints(Curve=explode.Segments)  # -> Start, End
range = Range(Domain=Domain(0, 1), Steps=expr("x-1", number_slider_2))
vector_2pt = Vector2Pt(PointA=end_points.Start, PointB=end_points.End, Unitize=False)  # -> Vector, Length
vector_display = VectorDisplay(Anchor=end_points.Start, Vector=vector_2pt.Vector)
flip_matrix_2 = FlipMatrix(Data=vector_2pt.Vector)
multiplication_2 = Multiplication(A=flip_matrix_2, B=range)
move_5 = Move(Geometry=divide_curve_2.Points, Motion=multiplication_2)  # -> Geometry, Transform

polyline_3 = PolyLine(Vertices=flatten(move_5.Geometry), Closed=False)
control_points = ControlPoints(Curve=polyline_3)  # -> Points, Weights, Knots
pdecon = Deconstruct(Point=control_points.Points)  # -> XComponent, YComponent, ZComponent

# ---- group: 2 Kommastellen
number_slider_3 = Slider(100, range=0..100)
number_slider_4 = Slider(100, range=0..100)
number_slider_5 = Slider(100, range=0..100)
multiplication_3 = Multiplication(A=pdecon.ZComponent, B=number_slider_3)
multiplication_4 = Multiplication(A=pdecon.YComponent, B=number_slider_4)
multiplication_5 = Multiplication(A=pdecon.XComponent, B=number_slider_5)
int = Integer(multiplication_4)
int_2 = Integer(multiplication_3)
int_3 = Integer(multiplication_5)
division = Division(A=int_2, B=number_slider_3)
division_2 = Division(A=int, B=number_slider_4)
division_3 = Division(A=int_3, B=number_slider_5)

# ---- group: Länge der Segmente
explode_2 = Explode(Curve=polyline_3, Recursive=True)  # -> Segments, Vertices
len = Length(Curve=explode_2.Segments)
number_slider_6 = Slider(0, range=0..100)

# ----
division_4 = Division(A=len, B=e_wert)

# ---- group: Länge der Segmente (continued)
ins = InsertItems(List=division_4, Item=number_slider_6, Indices=number_slider_6, Wrap=True)

# ---- group: 2 Kommastellen
number_slider_7 = Slider(100, range=0..100)
multiplication_6 = Multiplication(A=ins, B=number_slider_7)
int_4 = Integer(multiplication_6)
division_5 = Division(A=int_4, B=number_slider_7)

# ----
ma = MassAddition(Input=division_5)  # -> Result, PartialResults
concat = Concatenate(
    FragmentH=move_3,
    FragmentG=speed,
    FragmentI=multiplication,
    FragmentA=X,
    FragmentB=division_3,
    FragmentC=Y,
    FragmentD=division_2,
    FragmentE=Z,
    FragmentF=division,
    FragmentJ=extrude_rate,
    FragmentK=ma.PartialResults)
core = Panel(concat)
merge = Merge(Data1=flatten(start), Data2=flatten(core), Data3=flatten(end))
final_gcode = Panel(merge)
