# Grasshopper definition robo_printing.gh (Grasshopper 1.0.7)
# plug-ins: Bifocals, Robots

unit_x = UnitX(Factor=Slider(-500, range=-500..500))

unit_x_2 = UnitX(Factor=Slider(0, range=0..1000))
curve = Curve(<curve referenced from the Rhino model>)
move = Move(Geometry=curve, Motion=unit_x_2)  # -> Geometry, Transform

control_points = ControlPoints(Curve=move.Geometry)  # -> flatten(Points), Weights, Knots

point = Point(<point referenced from the Rhino model>)
brep = Brep([<brep referenced from the Rhino model> x16])
yz_plane = YZPlane(Origin=point)
mesh_brep = MeshBrep(
    Brep=brep,
    Settings={GridMaxCount=0, GridMinCount=16, JaggedSeams=False, MaxEdgeLength=0, MinEdgeLength=0.0001, MinTolerance=0, Refine=True, RefineAngle=0, RelativeTolerance=0.65, SimplePlanes=True, Tolerance=0})
rotate_plane = RotatePlane(Plane=yz_plane, Angle=degrees(90))
mesh_join = MeshJoin(Meshes=mesh_brep)
create_tool = CreateTool(Name="DefaultGHTool", TCP=rotate_plane, Weight=0, Mesh=mesh_join)  # -> Tool, TCP

xy_plane = XYPlane(Origin=control_points.Points)
flip_plane = FlipPlane(Plane=xy_plane, ReverseX=False, ReverseY=False, SwapAxes=True)
list = ValueList({"KULeuven-IRB120", "KULeuven-UR5", "KULeuven-UR10"}, selected="KULeuven-UR10")
load_robot_system = LoadRobotSystem(Name=list, Base=PlaneXY(0, 0, 0))
create_target = CreateTarget(Plane=flip_plane, Tool=create_tool.Tool, IsCartesian=True)
create_program = CreateProgram(Name="DefaultProgram", RobotSystem=load_robot_system, Targets1=create_target, StepSize=1)  # -> Program, Code, Duration, Warnings, Errors
program_simulation = ProgramSimulation(Program=create_program.Program, Time=Slider(0.5, range=0..0.5), Normalized=True)  # -> SystemMeshes, JointRotations, Plane, Index, Time, Program, Errors
deconstruct_program_targets = DeconstructProgramTargets(Program=create_program.Program)  # -> Planes, Joints, Configuration, DeltaTime
list_item = ListItem(List=deconstruct_program_targets.Planes, Index=-1, Wrap=True)  # -> flatten(Item)
ur10 = ColourSwatch(SwatchColor=RGB(128, 188, 193))
custom_preview = CustomPreview(Geometry=program_simulation.SystemMeshes, Material=ur10)
split_list = SplitList(List=list_item, Index=program_simulation.Index)  # -> ListA, ListB
polyline = PolyLine(Vertices=split_list.ListA, Closed=False)
custom_preview_2 = CustomPreview(Geometry=polyline, Material=ColourSwatch(SwatchColor=RGB(0, 0, 0)))

number_slider = Slider(25, range=0..100)
square = Square(Plane=PlaneXY(0, 0, 0), Size=1, ExtentX=number_slider, ExtentY=number_slider)  # -> Cells, Points
bounding_box = BoundingBox(Content=flatten(square.Cells), Plane=PlaneXY(0, 0, 0), UnionBox=True)  # -> Box, Box_2
deconstruct_brep = DeconstructBrep(Brep=bounding_box.Box)  # -> Faces, Edges, Vertices
list_item_2 = ListItem(List=deconstruct_brep.Faces, Index=0, Wrap=True)
surface = Surface(reparameterize(<surface referenced from the Rhino model>))
map_to_surface = MapToSurface(Curve=square.Cells, Source=list_item_2, Target=surface)  # -> flatten(Curve)
discontinuity = Discontinuity(Curve=map_to_surface, Level=1)  # -> Points, Parameters
surface_closest_point = SurfaceClosestPoint(Point=discontinuity.Points, Surface=surface)  # -> Point, UVPoint, Distance
evaluate_surface = EvaluateSurface(Surface=surface, Point=surface_closest_point.UVPoint)  # -> Point, Normal, UDirection, VDirection, Frame
deconstruct_vector = DeconstructVector(Vector=evaluate_surface.Normal)  # -> XComponent, YComponent, ZComponent
vector_xyz = VectorXYZ(XComponent=deconstruct_vector.XComponent, YComponent=deconstruct_vector.YComponent, ZComponent=0)  # -> Vector, Length
amplitude = Amplitude(Vector=vector_xyz.Vector, Amplitude=Slider(20, range=0..100))
number_slider_2 = Slider(20, range=0..100)
move_2 = Move(Geometry=evaluate_surface.Point, Motion=amplitude)  # -> Geometry, Transform
flip_matrix = FlipMatrix(Data=discontinuity.Points)
flip_matrix_2 = FlipMatrix(Data=move_2.Geometry)
center_box = CenterBox(Base=PlaneXY(0, 0, 0), X=number_slider_2, Y=number_slider_2, Z=number_slider_2)
panel = Panel("""2
1
6
5
3
7
6
2
3
1""")
explode_tree = ExplodeTree(Data=flip_matrix)  # -> Branch0, Branch1, Branch2, Branch3
explode_tree_2 = ExplodeTree(Data=flip_matrix_2)  # -> Branch0, Branch1, Branch2, Branch3
deconstruct_brep_2 = DeconstructBrep(Brep=center_box)  # -> Faces, Edges, Vertices
list_item_3 = ListItem(List=deconstruct_brep_2.Vertices, Index=panel, Wrap=True)
twisted_box = TwistedBox(
    CornerA=explode_tree.Branch0,
    CornerB=explode_tree.Branch1,
    CornerC=explode_tree.Branch2,
    CornerD=explode_tree.Branch3,
    CornerE=explode_tree_2.Branch0,
    CornerF=explode_tree_2.Branch1,
    CornerG=explode_tree_2.Branch2,
    CornerH=explode_tree_2.Branch3)
polyline_2 = PolyLine(Vertices=list_item_3, Closed=False)
box_morph = BoxMorph(Geometry=polyline_2, Reference=center_box, Target=twisted_box)  # -> reverse(Geometry)

move_3 = Move(Geometry=box_morph, Motion=unit_x)  # -> Geometry, Transform

partition_list = PartitionList(List=move_3.Geometry, Size=number_slider)
curve_2 = Curve(reverse(partition_list))
flip_matrix_3 = FlipMatrix(Data=partition_list)
flip_matrix_4 = FlipMatrix(Data=curve_2)
dispatch = Dispatch(List=flip_matrix_4, DispatchPattern=invert([True, False]))  # -> ListA, ListB
dispatch_2 = Dispatch(List=flip_matrix_3, DispatchPattern=[True, False])  # -> ListA, ListB
weave = Weave(Pattern=[0, 1], Stream0=dispatch_2.ListA, Stream1=dispatch.ListA, NullGaps=False)
flip_matrix_5 = FlipMatrix(Data=weave)  # -> flatten(Data)
